# Grasshopper definition CBDM - Assignment 01 - ninad Chavan - Hops ACP.gh (Grasshopper 1.0.7)
# plug-ins: Kangaroo2 Components, Pufferfish

ceiling_height = GetNumber(Slider(10, range=0..10), AtLeast=1, AtMost=1, Maximum=1.797693135e+308, Minimum=-1.797693135e+308, TreeAccess=False)
seed = GetInteger(Slider(2, range=0..10), AtLeast=1, AtMost=1, Maximum=2147483647, Minimum=-2147483648, TreeAccess=False)
width = GetNumber(Slider(11, range=0..100), AtLeast=1, AtMost=1, Maximum=1.797693135e+308, Minimum=-1.797693135e+308, TreeAccess=False)
length = GetNumber(Slider(25, range=0..100), AtLeast=1, AtMost=1, Maximum=1.797693135e+308, Minimum=-1.797693135e+308, TreeAccess=False)

curve_u = GetNumber(Slider(3, range=0..15), AtLeast=1, AtMost=1, Maximum=1.797693135e+308, Minimum=-1.797693135e+308, TreeAccess=False)
curve_v = GetNumber(Slider(7, range=3..15), AtLeast=1, AtMost=1, Maximum=1.797693135e+308, Minimum=-1.797693135e+308, TreeAccess=False)
count_u = GetNumber(Slider(7, range=3..15), AtLeast=1, AtMost=1, Maximum=1.797693135e+308, Minimum=-1.797693135e+308, TreeAccess=False)
count_v = GetNumber(Slider(11, range=3..15), AtLeast=1, AtMost=1, Maximum=1.797693135e+308, Minimum=-1.797693135e+308, TreeAccess=False)

construct_point = ConstructPoint(XCoordinate=0, YCoordinate=0, ZCoordinate=ceiling_height)
xy_plane = XYPlane(Origin=construct_point)
plane_surface = PlaneSurface(Plane=xy_plane, XSize=width, YSize=length)
construct_domain = ConstructDomain(DomainStart=Slider(0, range=0..3.5), DomainEnd=Slider(4.448, range=0..5.5))
divide_surface = DivideSurface(Surface=plane_surface, UCount=curve_u, VCount=curve_v)  # -> Points, Normals, Parameters
divide_surface_2 = DivideSurface(Surface=plane_surface, UCount=count_u, VCount=count_v)  # -> Points, Normals, Parameters
list_length = ListLength(List=flatten(divide_surface.Points))
random = Random(Range=construct_domain, Number=list_length, Seed=seed)
unit_z = UnitZ(Factor=random)
negative = Negative(Value=unit_z)
panel = Panel(list_length)
move = Move(Geometry=flatten(divide_surface.Points), Motion=negative)  # -> Geometry, Transform
addition = Addition(A=curve_u, B=Slider(1, range=0..10))
surface_from_points = SurfaceFromPoints(Points=move.Geometry, UCount=addition, Interpolate=False)
project_point = ProjectPoint(Point=divide_surface_2.Points, Direction=Vector(0, 0, -1), Geometry=surface_from_points)  # -> Point, Index
offset_curve = OffsetCurve(Curve=plane_surface, Plane=PlaneXY(0, 0, 0), Distance=1, BothSides=0, Kinks=0, CapType=1)
line = Line(StartPoint=divide_surface_2.Points, EndPoint=project_point.Point)
circle = Circle(Plane=project_point.Point, Radius=Slider(0.7, range=0..0.7))
unit_z_2 = UnitZ(Factor=Slider(0.06, range=0.01..0.5))
unit_z_3 = UnitZ(Factor=Slider(0.09, range=0.01..0.5))
curve = Curve(line)
extrude = Extrude(Base=circle, Direction=unit_z_2)
extrude_2 = Extrude(Base=offset_curve, Direction=unit_z_3)
multipipe = MultiPipe(
    Curves=curve,
    NodeSize=0.5,
    EndOffset=1,
    StrutSize=Slider(0.024, range=0..2),
    Segment=0,
    KinkAngle=0.6,
    CubeFit=0,
    Caps=0)
cap_holes = CapHoles(Brep=extrude)
cap_holes_2 = CapHoles(Brep=extrude_2)
merge = Merge(Data1=cap_holes, Data2=multipipe, Data3=cap_holes_2)
context_bake = ContextBake(Geometry=merge)
